# Grasshopper definition Belt_generator.gh (Grasshopper 1.0.7)
# plug-ins: Pufferfish

# ---- group: Pulley
teeth_width = Slider(1, range=0..100)
number_slider = Slider(1.2, range=0..100)
xy = XYPlane(Origin=Point(0, 0, 0))
neg = Negative(Value=teeth_width)
neg_2 = Negative(Value=number_slider)
pt = ConstructPoint(XCoordinate=neg, YCoordinate=neg_2, ZCoordinate=0)
pt_2 = ConstructPoint(XCoordinate=teeth_width, YCoordinate=number_slider, ZCoordinate=0)
cir = Circle(Plane=PlaneXY(0, 0, 0), Radius=Slider(7, range=0..100))
ellipse = Ellipse(Plane=xy, Radius1=Slider(13, range=0..100), Radius2=Slider(0, range=0..300))  # -> Ellipse, Focus1, Focus2
rec_2pt = Rectangle2Pt(Plane=xy, PointA=pt, PointB=pt_2, Radius=Slider(0.863, range=0..100))  # -> Rectangle, Length
curvepoint = PointOnCurve(cir, parameter=1)
Y = UnitY(Factor=curvepoint)
panel = Panel("Elliptical Hinges")
panel_2 = Panel("Rectengular Hinges")
elliptical_hinges = Move(Geometry=ellipse.Ellipse, Motion=Y)  # -> Geometry, Transform
move = Move(Geometry=rec_2pt.Rectangle, Motion=Y)  # -> Geometry, Transform
arrpolar = PolarArray(Geometry=move.Geometry, Plane=PlaneXY(0, 0, 0), Count=Slider(12, range=0..100), Angle=6.283185307)  # -> Geometry, Transform
trim = TrimWithRegions(Curve=cir, Regions=arrpolar.Geometry)  # -> Inside, Outside
trim_2 = TrimWithRegions(Curve=arrpolar.Geometry, Regions=cir)  # -> Inside, Outside
geo = Geometry(trim_2.Outside)
geo_2 = Geometry(trim.Outside)
bottom_top_diam = Slider(15, range=0..100)
hole_radius = Slider(6.5, range=0..100)
height_of_pulley = Slider(21, range=0..100)
join = JoinCurves(Curves=flatten([geo, geo_2]), Preserve=False)
xy_2 = XYPlane(Origin=Point(0, 0, 0))
xy_3 = XYPlane(Origin=Point(0, 0, 0))
Z = UnitZ(Factor=height_of_pulley)
extr = Extrude(Base=join, Direction=Z)  # disabled
cir_2 = Circle(Plane=xy_2, Radius=bottom_top_diam)
Z_2 = UnitZ(Factor=Slider(3, range=0..100))
cir_3 = Circle(Plane=xy_3, Radius=hole_radius)
cap = CapHoles(Brep=extr)
extr_2 = Extrude(Base=cir_2, Direction=Z_2)
Z_3 = UnitZ(Factor=height_of_pulley)
cap_2 = CapHoles(Brep=extr_2)
extr_3 = Extrude(Base=cir_3, Direction=Z_3)
move_2 = Move(Geometry=cap_2, Motion=Z_3)  # -> Geometry, Transform
cap_3 = CapHoles(Brep=extr_3)
scale_nu = ScaleNU(Geometry=cap_3, Plane=PlaneXY(0, 0, 0), ScaleX=1, ScaleY=1, ScaleZ=Slider(1.8, range=0..10))  # -> Geometry, Transform
sunion = SolidUnion(Breps=[cap, move_2.Geometry, cap_2])
sdiff = SolidDifference(BrepsA=sunion, BrepsB=flatten(scale_nu.Geometry))  # -> flatten(Result)
sunion_2 = SolidUnion(Breps=sdiff)

# ----
crv = Curve(<curve referenced from the Rhino model>)
pt_3 = ConstructPoint(XCoordinate=0, YCoordinate=0, ZCoordinate=0)
hframes = HorizontalFrames(Curve=crv, Count=Slider(112, range=0..1000))  # -> Frames, Parameters
dispatch = Dispatch(List=hframes.Frames, DispatchPattern=[True, False])  # -> ListA, ListB
deplane = DeconstructPlane(Plane=dispatch.ListB)  # -> Origin, XAxis, YAxis, ZAxis
crv_2 = Curve(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)
area = Area(Geometry=crv_2)  # -> Area, Centroid
Y_2 = UnitY(Factor=Slider(-0.5, range=-5..6))
ins = InsertItems(List=deplane.XAxis, Item="{1,0,0}", Indices=0, Wrap=True)
move_3 = Move(Geometry=area.Centroid, Motion=Y_2)  # -> Geometry, Transform
cull_i = CullIndex(List=ins, Indices=-1, Wrap=True)  # -> flatten(List)
angle = Angle(VectorA=deplane.XAxis, VectorB=cull_i, Plane=deplane.Origin)  # -> Angle, Reflex
angle_2 = Angle(VectorA=deplane.XAxis, VectorB=cull_i)  # -> Angle, Reflex
python = GhPythonScript(angles=angle.Angle, b_vecs=cull_i)  # -> out, new_vecs, flatten(dirs); inputs angles: list, b_vecs: list of Vector3d
# ---------- python: Python ----------
import math
import Rhino.Geometry as rg

new_vecs = []
dirs = []

def calc_kat(vec, a):
    new_x = vec.Length * math.sin(a)
    new_y = vec.Length * math.sin(math.pi/2 - a)
    return rg.Vector3d(new_x, new_y, 0)

def get_dir(vec):
    dir = "CCW"
    if vec.X >= 0:
        dir = "CW"
    return dir

for vec, a in zip(b_vecs, angles):
    new_x = calc_kat(vec, a)
    new_vecs.append(new_x)
    dirs.append(get_dir(new_x))
# ---------- end python ----------
move2pt = MoveToPoint(Geometry=crv_2, PointA=move_3.Geometry, PointB=deplane.Origin)  # -> Moved, Vector, Transform
deg = Degrees(Radians=angle_2.Angle)
python_2 = GhPythonScript(pts=deplane.Origin, angles=deg, pts_dir=python.dirs)  # -> out, a; inputs pts: list of Point3d, angles: list, pts_dir: list
# ---------- python_2: Python ----------
new_angles = []

for pt, angle, dir in zip(pts, angles, pts_dir):
    if dir == "CCW":
        a = -angle
    else:
        a = angle
    new_angles.append(a)

a = new_angles
# ---------- end python_2 ----------
ma = MassAddition(Input=python_2.a)  # -> Result, flatten(PartialResults)
rotate = Rotate(Geometry=move2pt.Moved, Angle=expr("360-x", degrees(ma.PartialResults)), Plane=deplane.Origin)  # -> Geometry, Transform
